# Grasshopper definition sunglasses.gh (Grasshopper 1.0.7)
# plug-ins: ShapeDiverForGrasshopper

sddp = ShapeDiverDocumentPayload({AbsoluteTolerance=0, AngleTolerance=0, DistanceDisplayPrecision=0, GltfVersion="Gltf2", GrasshopperVersion="1.0.0007", InputGroups="{}", OutputGroups="{}", RelativeTolerance=0, RhinoVersion="7.32.23221.10241", UnitSystem=0, VersionCreated="1.15.0.0", VersionSaved="1.15.0.0"})
pt = ConstructPoint(XCoordinate="0", YCoordinate="0", ZCoordinate="0")
Z = UnitZ(Factor=1)
X = UnitX(Factor=1)
pl = ConstructPlane(Origin=pt, XAxis=X, YAxis=Z)
zx_plane = Plane(pl)

bridge_length = Slider(5, range=5..10)
radius = Slider(50, range=25..50)
rim_shape = Slider(8, range=4..8)
bridge_height = Slider(1, range=0..15)
frame_radius = Number(radius)
addition = Addition(A=frame_radius, B=bridge_length)
bridge_height_2 = Number(bridge_height)
box = DomainBox(Base=zx_plane, X=addition, Y="10", Z="15")
polygon = Polygon(Plane=zx_plane, Radius=frame_radius, Segments=rim_shape, FilletRadius="4")  # -> Polygon, Length
vec = VectorXYZ(XComponent=0, YComponent=0, ZComponent=bridge_height_2)  # -> Vector, Length
Y = UnitY(Factor=1)
multiplication = Multiplication(A=Y, B="-15")
right_eye_frame = Brep(polygon.Polygon)
extr = Extrude(Base=polygon.Polygon, Direction=multiplication)
move = Move(Geometry=box, Motion=vec.Vector)  # -> Geometry, Transform
debrep = DeconstructBrep(Brep=move.Geometry)  # -> Faces, Edges, Vertices
int = Integer(5)
points = PointList(Points=debrep.Vertices, Size=int)
item = ListItem(List=debrep.Vertices, Index="6", Wrap=True)
item_2 = ListItem(List=debrep.Vertices, Index="2", Wrap=True)
item_3 = ListItem(List=debrep.Vertices, Index="1", Wrap=True)

wiggle = Slider(17, range=-20..20)
frame_radius_2 = Number(radius)
Z_2 = UnitZ(Factor=1)
Y_2 = UnitY(Factor=1)
bridge_height_3 = Number(bridge_height)
multiplication_2 = Multiplication(A=frame_radius_2, B="-1")
arm_shape = Slider(8, range=3..8)
arm_length = Slider(72.658, range=40..80)
addition_2 = Addition(A=bridge_height_3, B=wiggle)
pl_2 = ConstructPlane(Origin=pt, XAxis=Y_2, YAxis=Z_2)
subtraction = Subtraction(A=multiplication_2, B="8")
addition_3 = Addition(A="80", B=arm_length)
subtraction_2 = Subtraction(A=bridge_height_3, B=wiggle)
polygon_2 = Polygon(Plane=pl_2, Radius="5", Segments=arm_shape, FilletRadius="1")  # -> Polygon, Length
subtraction_3 = Subtraction(A=bridge_height_3, B="20")
pt_2 = ConstructPoint(XCoordinate=subtraction, YCoordinate=addition_3, ZCoordinate=bridge_height_3)
pdecon = Deconstruct(Point=pt_2)  # -> XComponent, YComponent, ZComponent
pt_3 = ConstructPoint(XCoordinate=multiplication_2, YCoordinate="-7.5", ZCoordinate=bridge_height_3)
pt_4 = ConstructPoint(XCoordinate=0, YCoordinate="-7.5", ZCoordinate=bridge_height_3)
pt_5 = ConstructPoint(XCoordinate=subtraction, YCoordinate="-7.5", ZCoordinate=bridge_height_3)
pt_6 = ConstructPoint(XCoordinate=subtraction, YCoordinate="40", ZCoordinate=addition_2)
pt_7 = ConstructPoint(XCoordinate=subtraction, YCoordinate="80", ZCoordinate=subtraction_2)
addition_4 = Addition(A=pdecon.YComponent, B="40")
pt_8 = ConstructPoint(XCoordinate="-25", YCoordinate=addition_4, ZCoordinate=subtraction_3)
vec_2 = VectorXYZ(XComponent=0, YComponent="-7.5", ZComponent=bridge_height_2)  # -> Vector, Length
move_2 = Move(Geometry=polygon_2.Polygon, Motion=vec_2.Vector)  # -> Geometry, Transform
merge = Merge(Data1=pt_4, Data2=pt_3, Data3=pt_5, Data4=pt_6, Data5=pt_7, Data6=pt_2, Data7=pt_8)
intcrv_t = InterpolateT(Vertices=merge, TangentStart=Vector(0, 0, 0), TangentEnd=Vector(0, 0, 0), KnotStyle=1)  # -> Curve, Length, Domain
swp1 = Sweep1(Rail=intcrv_t.Curve, Sections=move_2.Geometry, Miter=1)

right_origin = Point(pt)

division = Division(A=frame_radius, B="3")
Y_3 = UnitY(Factor=1)
subtraction_4 = Subtraction(A=frame_radius, B=division)
frame_thickness = Number(subtraction_4)
multiplication_3 = Multiplication(A=Y_3, B="10")
move_3 = Move(Geometry=zx_plane, Motion=multiplication_3)  # -> Geometry, Transform
cyl = Cylinder(Base=move_3.Geometry, Radius=frame_thickness, Length="100")
cap = CapHoles(Brep=extr)
right_eye_hole = Brep(cyl)

pl_3pt = Plane3Pt(PointA=item_2, PointB=item_3, PointC=item)
merge_2 = Merge(Data1=cap, Data2=move.Geometry)
cap_2 = CapHoles(Brep=right_eye_hole)
sunion = SolidUnion(Breps=merge_2)
cap_3 = CapHoles(Brep=swp1)
sdiff = SolidDifference(BrepsA=sunion, BrepsB=cap_2)
sdiff_2 = SolidDifference(BrepsA=cap_3, BrepsB=cap_2)
lens_and_nose_brigde = Brep(sdiff)
merge_3 = Merge(Data1=sdiff, Data2=sdiff_2)
sunion_2 = SolidUnion(Breps=merge_3)
mirror = Mirror(Geometry=sunion_2, Plane=pl_3pt)  # -> Geometry, Transform
merge_4 = Merge(Data1=sunion_2, Data2=mirror.Geometry)
sunion_3 = SolidUnion(Breps=merge_4)
preview = CustomPreview(Geometry=sunion_3, Material=ColourSwatch(SwatchColor=RGB(71, 67, 67)))
